# Grasshopper definition GluLamb - All Examples.gh (Grasshopper 1.0.7)
# plug-ins: tasCore, GluLamb

# ---- group: Create glulam
crv = Curve(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)
list = ValueList({"TopLeft": 0, "TopCentre": 1, "TopRight": 2, "MiddleLeft": 3, "MiddleCentre": 4, "MiddleRight": 5, "BottomLeft": 6, "BottomCentre": 7, "BottomRight": 8}, selected="MiddleCentre")
getk = EstimateCurvature(Curve=crv, NumSamples=100)  # -> MaxKX, MaxKY
glulamdata = GlulamData(Samples=100, Alignment=list, WidthX="0.1", HeightY="0.2", CurvatureX=getk.MaxKX, CurvatureY=getk.MaxKY)
glulam = Glulam(Curve=crv, Data=glulamdata)

# ----
brep = Brep(glulam)

# ---- group: Grain deviation analysis
glulam_2 = GlulamParameter(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)
grdev = MeshGrainDeviation(Glulam=glulam_2, Mesh=glulam_2, Faces=False)
gradient = Gradient(LowerLimit=0, UpperLimit=1, Parameter=grdev, stops=[0: RGB(0, 204, 0), 0.5: RGB(255, 255, 0), 1: RGB(255, 0, 0)])
mcol = MeshColours(Mesh=glulam_2, Colours=gradient)

# ---- group: Curvature analysis
glulam_3 = GlulamParameter(glulam)
lamk = AnalyzeLamellaBending(Glulam=glulam_3, Ratio=200)  # -> Mesh, Factor
gradient_2 = Gradient(LowerLimit=0, UpperLimit=1, Parameter=lamk.Factor, stops=[0: RGB(0, 204, 0), 0.5: RGB(255, 255, 0), 1: RGB(255, 0, 0)])
mcol_2 = MeshColours(Mesh=lamk.Mesh, Colours=gradient_2)

# ---- group: Grain direction visualization
glulam_4 = GlulamParameter(glulam)
mgdir = MeshGrainDirection(Glulam=glulam_4, Mesh=glulam_4, Faces=False)
bv2c = BidirVector2Color(Vector=mgdir)
mcol_3 = MeshColours(Mesh=glulam_4, Colours=bv2c)

# ---- group: Get parameters
list_2 = ValueList({"id", "centreline", "width", "height", "length", "lamella_width", "lamella_height", "lamella_count_width", "lamella_count_height", "volume", "samples", "max_curvature", "max_curvature_width", "max_curvature_height", "type", "type_id", "orientation"}, selected="id")
glulam_5 = GlulamParameter(glulam)
gparam = GetGlulamParameters(Glulam=glulam_5, Key=list_2)
panel = Panel(gparam)

# ---- group: Map geometry to glulam space
glulam_6 = GlulamParameter(glulam)
mesh = Mesh(glulam_6)
map2glulam = MapGeometryToGlulamSpace(Glulam=glulam_6, Geo=mesh)

# ---- group: Delaminate glulam
glulam_7 = GlulamParameter(glulam)
delam = Delaminate(Glulam=glulam_7, Type=Slider(0, range=0..2))  # -> Lamellae, Species, Reference

# ---- group: Get glulam frames
number_slider = Slider(1, range=0..1)
pt = Point(Point(0.2958685322, 0.009633250424, 0))
glulam_8 = GlulamParameter(glulam)
getframes = GetFrameList(Glulam=glulam_8, Parameters=number_slider)
gframe = GlulamFrame(Glulam=glulam_8, Point=pt, Flip=False)
gframe_t = GlulamFrameT(Glulam=glulam_8, Parameter=number_slider, Flip=False)

# ---- group: Get glulam face
bits3 = Bitmask3(Bitmask3=37, NumBits=6)
glulam_9 = GlulamParameter(glulam)
gface = GetGlulamFace(Glulam=glulam_9, Side=bits3)

# ---- group: Extract surface from glulam
bits3_2 = Bitmask3(Bitmask3=37, NumBits=6)
glulam_10 = GlulamParameter(glulam)
gsrf = GetGlulamSurface(Glulam=glulam_10, Side=bits3_2, Offset=0, Width="0.4", Extension="0.1")

# ---- group: Split glulam into pieces with optional overlap
glulam_11 = GlulamParameter(glulam)
panel_2 = Panel("""600
1000""")
splitg = SplitGlulam(Glulam=glulam_11, Parameter=panel_2, Overlap=0)
brep_2 = Brep(splitg)

# ---- group: Get glulam edge points
glulam_12 = GlulamParameter(glulam)
getedges = GetEdgePoints(Glulam=glulam_12, Samples=-1)  # -> TopRight, TopLeft, BottomRight, BottomLeft

# ---- group: Enlarge glulam
glulam_13 = GlulamParameter(glulam)
infglulam = InflateGlulam(Glulam=glulam_13, Amount="0.01")

# ---- group: Offset glulam section in 3d
glulam_14 = GlulamParameter(glulam)
ofglulam = OffsetGlulam(Glulam=glulam_14, OffsetX="0.1", OffsetY="0.1")
