# Grasshopper definition GluLamb - Get Frames.gh (Grasshopper 1.0.7)
# plug-ins: GluLamb

# ---- group: Create glulam
crv = Curve(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)
list = ValueList({"TopLeft": 0, "TopCentre": 1, "TopRight": 2, "MiddleLeft": 3, "MiddleCentre": 4, "MiddleRight": 5, "BottomLeft": 6, "BottomCentre": 7, "BottomRight": 8}, selected="MiddleCentre")
getk = EstimateCurvature(Curve=crv, NumSamples=100)  # -> MaxKX, MaxKY
glulamdata = GlulamData(Samples=100, Alignment=list, WidthX="0.1", HeightY="0.2", CurvatureX=getk.MaxKX, CurvatureY=getk.MaxKY)
glulam = Glulam(Curve=crv, Data=glulamdata)

# ---- group: Get glulam frames
glulam_2 = GlulamParameter(glulam)
number_slider = Slider(1, range=0..1)
pt = Point(Point(0.2958685322, 0.009633250424, 0))
getframes = GetFrameList(Glulam=glulam_2, Parameters=number_slider)
gframe = GlulamFrame(Glulam=glulam_2, Point=pt, Flip=False)
gframe_t = GlulamFrameT(Glulam=glulam_2, Parameter=number_slider, Flip=False)
