# Grasshopper definition GluLamb - Glulam Orientation.gh (Grasshopper 1.0.7)
# plug-ins: GluLamb

# ---- group: Surface orientation
crv = Curve(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)
brep = Brep(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)
project = Project(Curve=crv, Brep=brep, Direction=Vector(0, 0, 1))

# ----
list = ValueList({"TopLeft": 0, "TopCentre": 1, "TopRight": 2, "MiddleLeft": 3, "MiddleCentre": 4, "MiddleRight": 5, "BottomLeft": 6, "BottomCentre": 7, "BottomRight": 8}, selected="MiddleCentre")
getk = EstimateCurvature(Curve=crv, NumSamples=100)  # -> MaxKX, MaxKY
glulamdata = GlulamData(Samples=100, Alignment=list, WidthX="0.1", HeightY="0.2", CurvatureX=getk.MaxKX, CurvatureY=getk.MaxKY)

# ---- group: Single vector orientation
Z = UnitZ(Factor=1)
Y = UnitY(Factor=1)

# ---- group: Rail curve orientation
crv_2 = Curve(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)

# ---- group: Vector list orientation
crv_3 = Curve([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])

# ----
glulam = Glulam(Curve=crv, Orientation=crv_3, Data=glulamdata)
brep_2 = Brep(glulam)
