# Grasshopper definition GluLamb - Glulam Parameters.gh (Grasshopper 1.0.7)
# plug-ins: GluLamb

# ---- group: Create glulam
crv = Curve(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)
list = ValueList({"TopLeft": 0, "TopCentre": 1, "TopRight": 2, "MiddleLeft": 3, "MiddleCentre": 4, "MiddleRight": 5, "BottomLeft": 6, "BottomCentre": 7, "BottomRight": 8}, selected="MiddleCentre")
getk = EstimateCurvature(Curve=crv, NumSamples=100)  # -> MaxKX, MaxKY
glulamdata = GlulamData(Samples=100, Alignment=list, WidthX="0.1", HeightY="0.2", CurvatureX=getk.MaxKX, CurvatureY=getk.MaxKY)
glulam = Glulam(Curve=crv, Data=glulamdata)

# ---- group: Get parameters
list_2 = ValueList({"id", "centreline", "width", "height", "length", "lamella_width", "lamella_height", "lamella_count_width", "lamella_count_height", "volume", "samples", "max_curvature", "max_curvature_width", "max_curvature_height", "type", "type_id", "orientation"}, selected="id")
gparam = GetGlulamParameters(Glulam=glulam, Key=list_2)
panel = Panel(gparam)
