# Grasshopper definition GluLamb - Glulam Persistent Parameter.gh (Grasshopper 1.0.7)
# plug-ins: GluLamb

glulamdata = GlulamData(Samples=100, Alignment=4, WidthX="100", HeightY="200", DataMethod=0)
crv = Curve(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)
glulam = Glulam(Curve=crv, Data=glulamdata)
brep = Brep(glulam)
glulam_2 = GlulamParameter(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)
brep_2 = Brep(glulam_2)
panel = Panel(glulam_2)
