# Grasshopper definition GluLamb - Glulam Types.gh (Grasshopper 1.0.7)
# plug-ins: GluLamb

# ---- group: Create straight glulam
line = Curve(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)

# ---- group: Create single-curved glulam
planar_curve_2 = Curve(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)

planar_curve_1 = Curve(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)

# ---- group: Create double-curved glulam
non_planar_curve = Curve(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)

# ----
list = ValueList({"TopLeft": 0, "TopCentre": 1, "TopRight": 2, "MiddleLeft": 3, "MiddleCentre": 4, "MiddleRight": 5, "BottomLeft": 6, "BottomCentre": 7, "BottomRight": 8}, selected="MiddleCentre")
getk = EstimateCurvature(Curve=non_planar_curve, NumSamples=100)  # -> MaxKX, MaxKY
glulamdata = GlulamData(Samples=100, Alignment=list, WidthX="0.1", HeightY="0.2", CurvatureX=getk.MaxKX, CurvatureY=getk.MaxKY)

# ---- group: Create double-curved glulam (continued)
glulam = Glulam(Curve=non_planar_curve, Data=glulamdata)
panel = Panel(glulam)
brep = Brep(glulam)

# ---- group: Create straight glulam (continued)
glulam_2 = Glulam(Curve=line, Data=glulamdata)
panel_2 = Panel(glulam_2)
brep_2 = Brep(glulam_2)

# ---- group: Create single-curved glulam (continued)
glulam_3 = Glulam(Curve=planar_curve_2, Data=glulamdata)
panel_3 = Panel(glulam_3)
brep_3 = Brep(glulam_3)

glulam_4 = Glulam(Curve=planar_curve_1, Data=glulamdata)
panel_4 = Panel(glulam_4)
brep_4 = Brep(glulam_4)
