# Grasshopper definition GluLamb - Map To Glulam Space.gh (Grasshopper 1.0.7)
# plug-ins: GluLamb

# ---- group: Create glulam
crv = Curve(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)
list = ValueList({"TopLeft": 0, "TopCentre": 1, "TopRight": 2, "MiddleLeft": 3, "MiddleCentre": 4, "MiddleRight": 5, "BottomLeft": 6, "BottomCentre": 7, "BottomRight": 8}, selected="MiddleCentre")
getk = EstimateCurvature(Curve=crv, NumSamples=100)  # -> MaxKX, MaxKY
glulamdata = GlulamData(Samples=100, Alignment=list, WidthX="0.1", HeightY="0.2", CurvatureX=getk.MaxKX, CurvatureY=getk.MaxKY)
glulam = Glulam(Curve=crv, Data=glulamdata)

# ---- group: Map geometry to glulam space
mesh = Mesh(glulam)
map2glulam = MapGeometryToGlulamSpace(Glulam=glulam, Geo=mesh)
