# Grasshopper definition GluLamb - Structure and Joints.gh (Grasshopper 1.0.7)
# plug-ins: GluLamb

crv = Curve([<curve referenced from the Rhino model> x7])
brep = Brep(<brep referenced from the Rhino model>)
project = Project(Curve=crv, Brep=brep, Direction=Vector(0, 0, 1))

# ---- group: Create glulams
crv_2 = Curve([<curve referenced from the Rhino model> x5])
glulamdata = GlulamData(Samples=100, Alignment=4, WidthX="60", HeightY="120", DataMethod=0)
ext = ExtendCurve(Curve=project, Type=0, Start="100", End="100")
Z = UnitZ(Factor=1)
glulam = Glulam(Curve=ext, Data=glulamdata)

# ---- group: Create IDs
lng = ListLength(List=glulam)
repeat = RepeatData(Data="B", Length=lng)
series = Series(Start=0, Step=1, Count=lng)
concat = Concatenate(FragmentA=repeat, FragmentB=series)

# ---- group: Create structure
c_script = CSharpScript(
    Glulams_G=glulam,
    Ids_ID=concat,
    Reference=["C:\USERS\Tsvi\APPDATA\ROAMING\GRASSHOPPER\LIBRARIES\GLULAMB\GluLamb.dll", "C:\USERS\Tsvi\APPDATA\ROAMING\GRASSHOPPER\LIBRARIES\GLULAMB\GluLamb.GH.gha"])  # -> out, Structure_S, Joint_planes_JP, Joint_names_JN, Joint_type_JT, Joint_valence_JV, Joint_geometry_JG, graft(Beam_geometry_BG)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; inputs Glulams_G: tree, Ids_ID: tree of String
# ---------- c_script: C# usings ----------
using GluLamb;
using GluLamb.Factory;
using GluLamb.GH;
using System.Linq;
# ---------- c_script: C# ----------
    var elements = new List<BeamElement>();
    var data = G.AllData();
    var ids = ID.AllData();

    origins = new List<Point3d>();
    vectors = new List<Vector3d>();

    double extension = 100.0;

    for (int i = 0; i < data.Count; ++i)
      if (data[i] is Glulam)
      {
        var glulam = (data[i] as Glulam).Duplicate();
        //glulam.Extend(CurveEnd.Both, extension, CurveExtensionStyle.Smooth);

        var v = glulam.Centreline.PointAtEnd - glulam.Centreline.PointAtStart;
        Vector3d v2;
        if (glulam.Centreline.IsLinear(0.1))
        {
          v2 = glulam.GetPlane(glulam.Centreline.Domain.Mid).YAxis;
        }
        else
          v2 = glulam.Centreline.PointAt(glulam.Centreline.Domain.Mid) - glulam.Centreline.PointAtStart;
        var plane = new Plane(glulam.Centreline.PointAtStart, v, v2);

        elements.Add(new BeamElement(glulam, plane, ids[i]));

      }

    var structure = Structure.FromBeamElements(elements, 100.0, 10);

    // Work-around since Structure.FromBeamElements doesn't use the element names (TODO)
    // for (int i = 0; i < structure.Elements.Count; ++i)
    //   structure.Elements[i].Name = ids[i];

    for (int i = 0; i < structure.Connections.Count; ++i)
    {
      var conn = structure.Connections[i];
      var p0 = (conn.ElementA as BeamElement).Beam.GetPlane(conn.ParameterA);
      var p1 = (conn.ElementB as BeamElement).Beam.GetPlane(conn.ParameterB);

      conn.Plane = new Plane((p0.Origin + p1.Origin) / 2, -p0.ZAxis, p1.ZAxis);
      conn.Name = string.Format("{0}::{1}", conn.ElementA.Name, conn.ElementB.Name);
    }

    double radius = 50;
    double end_threshold = 150;
    double merge_distance = 120;

    var jcs = JointCondition.FindJointConditions(structure.Elements, radius, end_threshold, merge_distance);
    structure.Joints = JointCondition.ClassifyJoints(structure.Elements, jcs);

    /* Joint names */
    var joint_names = new List<string>();
    foreach(var joint in structure.Joints)
    {
      var tok = new List<string>();
      foreach (var part in joint.Parts)
      {
        tok.Add(structure.Elements[part.Index].Name);
      }

      joint_names.Add(string.Join("::", tok));
    }

    /* Joint planes */
    var joint_planes = new List<Plane>();
    foreach(var joint in structure.Joints)
    {
      Point3d centre = Point3d.Origin;
      foreach (var part in joint.Parts)
      {
        centre += (part.Element as BeamElement).Beam.Centreline.PointAt(part.Parameter);
      }

      centre = centre / joint.Parts.Length;

      joint_planes.Add(new Plane(centre, Vector3d.XAxis, Vector3d.YAxis));
    }

    /* Construct joint geometry */
    var joint_xtor = new GluLamb.Joints.JointConstructor();
    joint_xtor.ProcessCrossJoint = ProcessCrossJoint2;
    joint_xtor.ProcessFourWayJoint = ProcessFourWayJoint;
    joint_xtor.ProcessCornerJoint = ProcessCornerJoint;
    joint_xtor.ProcessTenonJoint = ProcessButtJoint;
    joint_xtor.ProcessJoints(structure.Joints);
    var jbreps = new DataTree<Brep>();

    for (int i = 0; i < structure.Joints.Count; ++i)
    {
      for (int j = 0; j < structure.Joints[i].Parts.Length; ++j)
      {
        jbreps.AddRange(structure.Joints[i].Parts[j].Geometry, new GH_Path(structure.Joints[i].Parts[j].Index));
      }
    }

    S = new GH_Structure(structure);
    JN = joint_names;
    JT = structure.Joints;
    JP = joint_planes;
    JV = structure.Joints.Select(x => x.Parts.Length);
    JG = jbreps;
    BG = structure.Elements.Select(x => (x as BeamElement).Beam.ToBrep());
    BH = structure.Elements.Select(x => x.Handle);
    O = origins;
    V = vectors;
# ---------- c_script: C# additional code ----------
  List<Point3d> origins = null;
  List<Vector3d> vectors = null;

  public bool ProcessCrossJoint2(CrossJoint cj)
  {
    var m_glulam1 = (cj.Over.Element as BeamElement).Beam as Glulam;
    var m_glulam2 = (cj.Under.Element as BeamElement).Beam as Glulam;
    var m_offset1 = 3.0;
    var m_offset2 = 3.0;
    var m_extension = 2.0;
    var offset_center = 10;

    var m_result = new List<Brep>();

    var m_drill_depth = 100.0;

    double tolerance = Rhino.RhinoDoc.ActiveDoc.ModelAbsoluteTolerance;
    double widthA = m_glulam1.Width;
    double heightA = m_glulam1.Height;
    double widthB = m_glulam2.Width;
    double heightB = m_glulam2.Height;

    bool flip = false;

    m_result = new List<Brep>();

    //
    // Find orientation relationship between glulams
    //

    Point3d ptA, ptB;
    m_glulam1.Centreline.ClosestPoints(m_glulam2.Centreline, out ptA, out ptB);

    Point3d CP = (ptA + ptB) / 2;
    Plane cPlane;

    double cDist = ptA.DistanceTo(ptB) / 2;

    Plane plA = m_glulam1.GetPlane(ptA);
    Plane plB = m_glulam2.GetPlane(ptB);

    double ofc = offset_center;
    double ofc2 = offset_center / 2;

    Vector3d vAB = ptB - ptA;
    Vector3d vBA = ptA - ptB;

    if (vAB.IsZero || vBA.IsZero)
    {
      vAB = plA.YAxis;
      vBA = -vAB;
    }
    else
    {
      vAB.Unitize();
      vBA.Unitize();
    }

    int
      yAFlip = vAB * plA.YAxis < 0 ? 1 : -1,
      yBFlip = vBA * plB.YAxis < 0 ? 1 : -1,
      xAFlip = plA.XAxis * plB.ZAxis < 0 ? 1 : -1,
      xBFlip = plB.XAxis * plA.ZAxis < 0 ? 1 : -1;

    m_result = new List<Brep>();

    //
    // Make center surface
    //

    Brep[] arrbrpCenterSides = new Brep[]
      {
      m_glulam1.GetSideSurface(0, (widthA / 2 - ofc2) * xAFlip, heightB * 3, m_extension, flip),
      m_glulam1.GetSideSurface(0, -(widthA / 2 - ofc2) * xAFlip, heightB * 3, m_extension, flip)
      };

    Brep brpCenterFlat = m_glulam2.GetSideSurface(1, cDist * yAFlip, widthB - ofc, m_extension, flip);


    Curve[] arrcrvCenterSides = new Curve[4];

    Curve[] xCurves;
    Point3d[] xPoints;
    Rhino.Geometry.Intersect.Intersection.BrepBrep(arrbrpCenterSides[0], brpCenterFlat, tolerance, out xCurves, out xPoints);

    if (xCurves.Length > 0)
      arrcrvCenterSides[0] = xCurves[0];
    else
    {
      m_result.Add(brpCenterFlat);
      m_result.AddRange(arrbrpCenterSides);
      //throw new Exception("Failed to intersect: 0");
      return false;
    }

    Rhino.Geometry.Intersect.Intersection.BrepBrep(arrbrpCenterSides[1], brpCenterFlat, tolerance, out xCurves, out xPoints);
    if (xCurves.Length > 0)
      arrcrvCenterSides[1] = xCurves[0];
    else
    {
      m_result.Add(brpCenterFlat);
      m_result.AddRange(arrbrpCenterSides);
      //throw new Exception("Failed to intersect: 1");
      return false;
    }

    Point3d[] cPoints = new Point3d[4];
    cPoints[0] = arrcrvCenterSides[0].PointAtStart;
    cPoints[1] = arrcrvCenterSides[0].PointAtEnd;
    cPoints[2] = arrcrvCenterSides[1].PointAtStart;
    cPoints[3] = arrcrvCenterSides[1].PointAtEnd;

    Plane.FitPlaneToPoints(cPoints, out cPlane);
    cPlane.Origin = CP;

    for (int i = 0; i < 4; ++i)
      cPoints[i] = cPlane.ClosestPoint(cPoints[i]);

    //arrcrvCenterSides[2] = new Line(arrcrvCenterSides[0].PointAtStart, arrcrvCenterSides[1].PointAtStart).ToNurbsCurve();
    //arrcrvCenterSides[3] = new Line(arrcrvCenterSides[0].PointAtEnd, arrcrvCenterSides[1].PointAtEnd).ToNurbsCurve();

    arrcrvCenterSides[0] = new Line(cPoints[0], cPoints[1]).ToNurbsCurve();
    arrcrvCenterSides[1] = new Line(cPoints[2], cPoints[3]).ToNurbsCurve();
    arrcrvCenterSides[2] = new Line(cPoints[0], cPoints[2]).ToNurbsCurve();
    arrcrvCenterSides[3] = new Line(cPoints[1], cPoints[3]).ToNurbsCurve();

    Brep brpCenterBrep = Brep.CreateEdgeSurface(arrcrvCenterSides);

    //
    // GlulamA Top
    //

    Brep brpGlulamATop = m_glulam1.GetSideSurface(1, (heightA / 2 + m_offset1) * -yAFlip, widthA + m_offset2, m_extension, false);

    //
    // GlulamA Sides
    //

    Brep[] arrbrpGlulamASides = new Brep[2];
    arrbrpGlulamASides[0] = m_glulam1.GetSideSurface(0, (widthA / 2 + m_offset1) * xAFlip, heightA * 2 + m_offset2, m_extension, flip);
    arrbrpGlulamASides[1] = m_glulam1.GetSideSurface(0, -(widthA / 2 + m_offset1) * xAFlip, heightA * 2 + m_offset2, m_extension, flip);

    //
    // GlulamB Bottom
    //

    Brep brpGlulamBBtm = m_glulam2.GetSideSurface(1, (heightB / 2 + m_offset1) * -yBFlip, widthB + m_offset2, m_extension, false);

    //
    // GlulamB Sides
    //

    Brep[] arrbrpGlulamBSides = new Brep[2];
    arrbrpGlulamBSides[0] = m_glulam2.GetSideSurface(0, (widthB / 2 + m_offset1) * xAFlip, heightB * 2 + m_offset2, m_extension, flip);
    arrbrpGlulamBSides[1] = m_glulam2.GetSideSurface(0, -(widthB / 2 + m_offset1) * xAFlip, heightB * 2 + m_offset2, m_extension, flip);

    //
    // Intersect GlulamA Top with GlulamB Sides
    //

    //m_result.Add(brpGlulamATop);
    //m_result.AddRange(arrbrpGlulamBSides);
    //return;

    Curve[] arrcrvATopBSides = new Curve[2];
    Rhino.Geometry.Intersect.Intersection.BrepBrep(brpGlulamATop, arrbrpGlulamBSides[0], tolerance, out xCurves, out xPoints);
    if (xCurves.Length > 0)
      arrcrvATopBSides[0] = xCurves[0];
    Rhino.Geometry.Intersect.Intersection.BrepBrep(brpGlulamATop, arrbrpGlulamBSides[1], tolerance, out xCurves, out xPoints);
    if (xCurves.Length > 0)
      arrcrvATopBSides[1] = xCurves[0];

    if (arrcrvATopBSides[0] == null || arrcrvATopBSides[1] == null)
    {
      //throw new Exception("Top sides are null.");
      return false;
    }
    //
    // Intersect GlulamB Bottom with GlulamA Sides
    //
    Curve[] arrcrvBBtmASides = new Curve[2];

    Rhino.Geometry.Intersect.Intersection.BrepBrep(brpGlulamBBtm, arrbrpGlulamASides[0], tolerance, out xCurves, out xPoints);
    if (xCurves.Length > 0)
      arrcrvBBtmASides[0] = xCurves[0];
    Rhino.Geometry.Intersect.Intersection.BrepBrep(brpGlulamBBtm, arrbrpGlulamASides[1], tolerance, out xCurves, out xPoints);
    if (xCurves.Length > 0)
      arrcrvBBtmASides[1] = xCurves[0];

    if (arrcrvBBtmASides[0] == null || arrcrvBBtmASides[1] == null) return false;

    //
    // Loft GlulamA Tops with Center
    //

    if (arrcrvCenterSides[3].TangentAtStart * arrcrvATopBSides[0].TangentAtStart < 0.0)
      arrcrvATopBSides[0].Reverse();

    Brep[] arrbrpTopCenterLoft1 =
      Brep.CreateFromLoft(
      new Curve[] { arrcrvCenterSides[3], arrcrvATopBSides[0] },
      Point3d.Unset, Point3d.Unset,
      LoftType.Straight, false);

    if (arrcrvCenterSides[2].TangentAtStart * arrcrvATopBSides[1].TangentAtStart < 0.0)
      arrcrvATopBSides[1].Reverse();

    Brep[] arrbrpTopCenterLoft2 =
      Brep.CreateFromLoft(
      new Curve[] { arrcrvCenterSides[2], arrcrvATopBSides[1] },
      Point3d.Unset, Point3d.Unset,
      LoftType.Straight, false);

    //
    // Loft GlulamB Bottoms with Center
    //

    if (arrcrvCenterSides[0].TangentAtStart * arrcrvBBtmASides[0].TangentAtStart < 0.0)
      arrcrvBBtmASides[0].Reverse();

    Brep[] arrbrpBtmCenterLoft1 =
      Brep.CreateFromLoft(
      new Curve[] { arrcrvCenterSides[0], arrcrvBBtmASides[0] },
      Point3d.Unset, Point3d.Unset,
      LoftType.Straight, false);

    if (arrcrvCenterSides[1].TangentAtStart * arrcrvBBtmASides[1].TangentAtStart < 0.0)
      arrcrvBBtmASides[1].Reverse();

    Brep[] arrbrpBtmCenterLoft2 =
      Brep.CreateFromLoft(
      new Curve[] { arrcrvCenterSides[1], arrcrvBBtmASides[1] },
      Point3d.Unset, Point3d.Unset,
      LoftType.Straight, false);

    //
    // Make webs
    //

    Brep web1 = Brep.CreateFromCornerPoints(
      arrcrvCenterSides[0].PointAtStart,
      arrcrvATopBSides[1].PointAtStart,
      arrcrvBBtmASides[0].PointAtStart,
      tolerance
      );

    Brep web2 = Brep.CreateFromCornerPoints(
      arrcrvCenterSides[0].PointAtEnd,
      arrcrvATopBSides[0].PointAtStart,
      arrcrvBBtmASides[0].PointAtEnd,
      tolerance
      );

    Brep web3 = Brep.CreateFromCornerPoints(
      arrcrvCenterSides[1].PointAtEnd,
      arrcrvATopBSides[0].PointAtEnd,
      arrcrvBBtmASides[1].PointAtEnd,
      tolerance
      );

    Brep web4 = Brep.CreateFromCornerPoints(
      arrcrvCenterSides[1].PointAtStart,
      arrcrvATopBSides[1].PointAtEnd,
      arrcrvBBtmASides[1].PointAtStart,
      tolerance
      );

    //
    // Populate the result list.
    //

    m_result.Add(brpCenterBrep);

    //m_result.Add(brpGlulamATop);
    //m_result.Add(brpGlulamBTop);
    m_result.AddRange(arrbrpTopCenterLoft1);
    m_result.AddRange(arrbrpTopCenterLoft2);
    m_result.AddRange(arrbrpBtmCenterLoft1);
    m_result.AddRange(arrbrpBtmCenterLoft2);

    m_result.Add(web1);
    m_result.Add(web2);
    m_result.Add(web3);
    m_result.Add(web4);

    var temp = Brep.JoinBreps(m_result, 0.001);
    if (temp.Length > 0)
    {
      m_result.Clear();
      m_result.AddRange(temp);
    }

    cj.Under.Geometry.AddRange(m_result);
    cj.Over.Geometry.AddRange(m_result);

    //var drill0 = new DoubleSidedCounterSunkDrill(
    //  cPlane,
    //  5.0, m_drill_depth, 10.0, 6.0);

    //drill0.Compute();

    //m_result.AddRange(drill0.GetCuttingGeometry());

    return true;

  }

  public bool ProcessFourWayJoint(FourWayJoint fj)
  {
    // Get point and normal of intersection
    var points = new Point3d[4];
    var vectors = new Vector3d[4];

    var average = fj.Plane.Origin;

    for (int i = 0; i < fj.Parts.Length; ++i)
    {
      var crv = (fj.Parts[i].Element as BeamElement).Beam.Centreline;
      points[i] = crv.PointAt(fj.Parts[i].Parameter);
      vectors[i] = crv.TangentAt(fj.Parts[i].Parameter);

      var midpt = crv.PointAt(crv.Domain.Mid);

      if ((points[i] - midpt) * vectors[i] < 0)
        vectors[i] = -vectors[i];

      //average = average + points[i];
    }

    //average = average / 3;

    for (int i = 0; i < vectors.Length; ++i)
    {
      int ii = (i + 1).Modulus(4);

      var v0beam = (fj.Parts[i].Element as BeamElement).Beam;
      var v1beam = (fj.Parts[ii].Element as BeamElement).Beam;

      var tangent = (vectors[i] + vectors[ii]) / 2;
      tangent.Unitize();

      var normal = Vector3d.CrossProduct(vectors[i], vectors[ii]);
      //var normal = fj.Plane.ZAxis;
      var binormal = Vector3d.CrossProduct(tangent, normal);

      Point3d vpt0, vpt1;
      var res = v0beam.Centreline.ClosestPoints(v1beam.Centreline, out vpt0, out vpt1);

      var vx = (vpt0 + vpt1) / 2;

      var vv0 = GluLamb.Joints.JointUtil.GetEndConnectionVector(v0beam, vx);
      var vv1 = GluLamb.Joints.JointUtil.GetEndConnectionVector(v1beam, vx);

      var yaxis = (v0beam.GetPlane(fj.Parts[i].Parameter).YAxis + v1beam.GetPlane(fj.Parts[ii].Parameter).YAxis) / 2;
      var v0plane = v0beam.GetPlane(vx);
      var v1plane = v1beam.GetPlane(vx);

      var xaxis0 = v0plane.XAxis;
      var xaxis1 = v1plane.XAxis;

      if (xaxis1 * xaxis0 < 0)
        xaxis1 = -xaxis1;

      yaxis = Vector3d.CrossProduct(xaxis0, xaxis1);

      var divPlane = new Plane(vx, (vv0 + vv1) / 2, yaxis);
      var divider = Brep.CreatePlanarBreps(new Curve[]{
        new Rectangle3d(divPlane, new Interval(-300, 300), new Interval(-300, 300)).ToNurbsCurve()}, 0.01);

      //breps.AddRange(divider, new GH_Path(vj.V0.Index));
      //breps.AddRange(divider, new GH_Path(vj.V1.Index));

      fj.Parts[i].Geometry.AddRange(divider);
      fj.Parts[ii].Geometry.AddRange(divider);
    }

    return true;
  }

  public bool ProcessCornerJoint(CornerJoint cj)
  {
    var part0 = cj.Parts[0];
    var part1 = cj.Parts[1];
    var beam0 = (part0.Element as BeamElement).Beam;
    var beam1 = (part1.Element as BeamElement).Beam;

    var plane0 = beam0.GetPlane(part0.Parameter);
    var plane1 = beam1.GetPlane(part1.Parameter);

    var origin = (plane0.Origin + plane1.Origin) / 2;

    int sign0 = 1;
    int sign1 = -1;

    var v0Crv = (part0.Element as BeamElement).Beam.Centreline;
    var v1Crv = (part1.Element as BeamElement).Beam.Centreline;

    var vv0 = GluLamb.Joints.JointUtil.GetEndConnectionVector(beam0, origin);
    var vv1 = GluLamb.Joints.JointUtil.GetEndConnectionVector(beam1, origin);

    origins.Add(origin);
    vectors.Add(vv0);
    origins.Add(origin);
    vectors.Add(vv1);

    if (vv1 * plane0.XAxis > 0)
      sign0 = -sign0;

    if (vv0 * plane1.XAxis > 0)
      sign1 = -sign1;

    var trimPlane = new Plane(plane0.Origin + plane0.XAxis * beam0.Width * 0.5 * sign0, plane0.ZAxis, plane0.YAxis);
    var trimmers = Brep.CreatePlanarBreps(new Curve[] { new Rectangle3d(trimPlane, new Interval(-300, 300), new Interval(-300, 300)).ToNurbsCurve() }, 0.01);
    part1.Geometry.AddRange(trimmers);

    trimPlane = new Plane(plane1.Origin + plane1.XAxis * beam1.Width * 0.5 * sign1, plane1.ZAxis, plane1.YAxis);
    trimmers = Brep.CreatePlanarBreps(new Curve[] { new Rectangle3d(trimPlane, new Interval(-300, 300), new Interval(-300, 300)).ToNurbsCurve() }, 0.01);
    part0.Geometry.AddRange(trimmers);

    return true;
  }

  public bool ProcessButtJoint(TenonJoint tj)
  {
    double dowelLength = 100.0;
    double dowelExtra = 50.0;
    var tbeam = (tj.Tenon.Element as BeamElement).Beam;
    var mbeam = (tj.Mortise.Element as BeamElement).Beam;

    var mplane = mbeam.GetPlane(tj.Mortise.Parameter);
    var tplane = tbeam.GetPlane(tj.Tenon.Parameter);

    var vec = tbeam.Centreline.PointAt(tbeam.Centreline.Domain.Mid) - tbeam.Centreline.PointAt(tj.Tenon.Parameter);
    int sign = 1;

    if (vec * mplane.XAxis < 0)
      sign = -sign;

    var tz = tplane.ZAxis;
    if (tz * vec > 0)
      tz = -tz;

    var trimPlane = new Plane(mplane.Origin + mplane.XAxis * mbeam.Width * 0.5 * sign, mplane.ZAxis, mplane.YAxis);
    var trimmer = Brep.CreatePlanarBreps(new Curve[]{new Rectangle3d(trimPlane,
      new Interval(-300, 300), new Interval(-300, 300)).ToNurbsCurve()}, 0.01);

    var xform = trimPlane.ProjectPointAlongVector(tplane.ZAxis);

    for (int i = -1; i < 2; i += 2)
    {
      Point3d dp = new Point3d(tplane.Origin
        + tplane.YAxis * 0.16 * tbeam.Height * i);

      dp.Transform(xform);
      dp.Transform(Transform.Translation(-tz * dowelLength * 0.5));

      var dowelPlane = new Plane(dp, tz);
      var cyl = new Cylinder(
        new Circle(dowelPlane, 6.0), dowelLength + dowelExtra).ToBrep(true, true);

      tj.Tenon.Geometry.Add(cyl);
      tj.Mortise.Geometry.Add(cyl);
    }
    tj.Tenon.Geometry.AddRange(trimmer);

    return true;
  }
# ---------- end c_script ----------

# ---- group: Label joints
gradient = Gradient(
    LowerLimit="2",
    UpperLimit="5",
    Parameter=c_script.Joint_valence_JV,
    stops=[0: RGB(0, 255, 255), 0.5: RGB(255, 255, 0), 1: RGB(255, 0, 0)])
filter = StreamFilter(Gate=Toggle(False), Stream0=c_script.Joint_type_JT, Stream1=c_script.Joint_names_JN)
tag = TextTag(Location=c_script.Joint_planes_JP, Text=filter, Colour=gradient)

# ----
vdis = VectorDisplay(Anchor=c_script.Origins_O, Vector=c_script.Vectors_V)
brep_2 = Brep(c_script.Joint_geometry_JG)

# ---- group: Cut beam geometry (SLOW) / Cut joints
# Cutting
cut = CutBrep(Brep=simplify(c_script.Beam_geometry_BG), Cutters=c_script.Joint_geometry_JG)

# ----
brep_3 = Brep(<brep referenced from the Rhino model>)
cut_2 = CutBrep(Brep=simplify(cut), Cutters=brep_3)

pt = Point(Point(-1152.591289, -3023.543375, 0))
c_distribute = CSharpScript(
    Origin_O=pt,
    Geometry_G=flatten(cut_2),
    Handles_H=flatten(c_script.Beam_handles_BH),
    XSpacing_XS="4000",
    YSpacing_YS="-2000",
    NumColumns_NC="3")  # -> out, Geometry_Gout, Planes_P; inputs Origin_O: Point3d, Geometry_G: list of GeometryBase, Handles_H: list of Plane, XSpacing_XS: Double, YSpacing_YS: Double, NumColumns_NC: Int32
# ---------- c_distribute: C# ----------
    int N = Math.Min(G.Count, H.Count);
    int nCol = NC;
    int nRow = (int) Math.Ceiling((double) N / nCol);

    var planes = new List<Plane>();
    var geometry = new List<GeometryBase>();

    int counter = 0;
    for (int i = 0; i < nRow; ++i)
    {
      for (int j = 0; j < nCol && counter < N; ++j, counter++)
      {
        var plane = new Plane(O + Vector3d.XAxis * XS * j + Vector3d.YAxis * YS * i,
          Vector3d.XAxis, Vector3d.YAxis);

        var geo = G[counter];
        geo.Transform(Transform.PlaneToPlane(H[counter], plane));
        geometry.Add(geo);

        planes.Add(plane);
      }
    }

    Gout = geometry;
    P = planes;
# ---------- end c_distribute ----------

material = CreateMaterial(Diffuse=RGB(255, 105, 180), Specular=RGB(255, 255, 255), Emission=RGB(0, 0, 0), Transparency=0, Shine=0)
preview = CustomPreview(Geometry=[cut_2, c_distribute.Geometry_Gout], Material=material)
